# Grasshopper definition example_file.gh (Grasshopper 1.0.7)
# plug-ins: g3gh Info

getfolder = GetCurrentFolder()  # -> path
# ---------- getfolder: Python ----------
__author__ = "joelhilmersson"

import rhinoscriptsyntax as rs

import os


if(ghdoc.Path):
    path = os.path.dirname(ghdoc.Path)
# ---------- end getfolder ----------
concat = Concatenate(FragmentA=getfolder, FragmentB="stanfordbunny.obj", JoinSeparator="/")
dmshfromobj = ReadFromFile(FilePath=concat)
setcols = SetMeshVertexColours(Mesh=dmshfromobj, Colours=ColourSwatch(SwatchColor=RGB(255, 255, 255)))
msmsh = MeshMeasurements(Mesh=setcols)  # -> Area, Volume
edgestats = MeshEdgeStatistics(Mesh=setcols)  # -> MaxEdgeLength, MinEdgeLength, AverageEdgeLength
iterholefill = IterativeMeshHoleFill(DMesh3=setcols, EdgeLength=1)
reduce = ReduceMesh(Mesh=setcols, NumberOfFaces=Slider(500, range=0..1000), ConstrainEdges=True, ProjectToInput=True)
xz = XZPlane(Origin=Point(0, 0, 0))
laplacesmooth = SmoothMesh(Mesh=iterholefill, InteriorWeight=Slider(0.1, range=0..0.1))
dm3 = DMesh3(laplacesmooth)
mshxpl = MeshPlaneCut(Mesh=dm3, Plane=xz, CapHoles=False)
mesh = Mesh(dm3)
dm3_2 = DMesh3(mshxpl)
edgeloops = MeshBoundaryEdgeLoops(DMesh3=dm3_2)
holefill = MeshHoleFill(Mesh=dm3_2, EdgeLoop=edgeloops, EdgeLength=Slider(3, range=0..10))
cleanmsh = CleanMesh(Mesh=holefill)
dm3_3 = DMesh3(cleanmsh)
repairmsh = RepairMesh(Mesh=dm3_3)
